# Grasshopper definition Phase 03_Model Integration_01 _Grasshopper Section.gh (Grasshopper 1.0.8)
# plug-ins: RhinoCodePluginGH

script = Script(
    Count=Slider(625, range=0..1000),
    Seed=Slider(49, range=0..100),
    ScaleMin=Slider(1, range=0..1),
    ScaleMax=Slider(2, range=0..10))  # -> out, a
# ---------- script: Python ----------
"""Grasshopper Script"""
a = "Hello Python 3 in Grasshopper!"
print(a)
import Rhino
import scriptcontext as sc
import random
import math

# --- 🌟 强制类型转换，完美替代 Type Hint ---
try:
    Count = int(Count)
    Seed = int(Seed)
    ScaleMin = float(ScaleMin)
    ScaleMax = float(ScaleMax)
except TypeError:
    pass # 防止一开始没连滑块时报错

# 1. 切到 Rhino 获取图层
sc.doc = Rhino.RhinoDoc.ActiveDoc 

def get_geo_from_layer(layer_name):
    layer = sc.doc.Layers.FindName(layer_name)
    if not layer: return []
    objs = sc.doc.Objects.FindByLayer(layer_name)
    return [obj.Geometry for obj in objs if obj.Geometry]

targets = get_geo_from_layer("mesh")
fragments = get_geo_from_layer("碎片")

# 2. 切回 GH
sc.doc = ghdoc 
ScatteredFrags = []

if not targets or not fragments:
    print("等待读取图层模型...")
else:
    random.seed(Seed)
    
    # 3. 融合底座大网格
    master_mesh = Rhino.Geometry.Mesh()
    for geo in targets:
        if isinstance(geo, Rhino.Geometry.Mesh):
            master_mesh.Append(geo)
        elif isinstance(geo, Rhino.Geometry.Brep):
            meshes = Rhino.Geometry.Mesh.CreateFromBrep(geo, Rhino.Geometry.MeshingParameters.Default)
            if meshes:
                for m in meshes: master_mesh.Append(m)
                
    master_mesh.FaceNormals.ComputeFaceNormals()
    
    # 4. 散布核心逻辑
    if master_mesh.Faces.Count > 0:
        for i in range(Count):
            f_idx = random.randint(0, master_mesh.Faces.Count - 1)
            center = master_mesh.Faces.GetFaceCenter(f_idx)
            normal = master_mesh.FaceNormals[f_idx]
            
            frag = random.choice(fragments).Duplicate()
            
            # 暴力对齐原点
            bbox = frag.GetBoundingBox(True)
            frag.Translate(Rhino.Geometry.Point3d.Origin - bbox.Center)
            
            # 对齐法线
            frag.Transform(Rhino.Geometry.Transform.Rotation(Rhino.Geometry.Vector3d.ZAxis, normal, Rhino.Geometry.Point3d.Origin))
            
            # 表面随机自转
            spin = random.uniform(0, math.pi * 2)
            frag.Transform(Rhino.Geometry.Transform.Rotation(spin, normal, Rhino.Geometry.Point3d.Origin))
            
            # 随机缩放
            s = random.uniform(ScaleMin, ScaleMax)
            frag.Transform(Rhino.Geometry.Transform.Scale(Rhino.Geometry.Point3d.Origin, s))
            
            # 移到面上
            frag.Translate(center - Rhino.Geometry.Point3d.Origin)
            
            ScatteredFrags.append(frag)
            
    print(f"✨ 成功生成 {len(ScatteredFrags)} 个双生碎片！")
a = ScatteredFrags
# ---------- end script ----------
custom_preview = CustomPreview(
    Geometry=script.a,
    Material={diffuse=RGB(221, 160, 221), emission=RGB(66, 48, 66), shine=0.5, specular=RGB(255, 255, 255), transparency=0})
